# Grasshopper definition Matrix_Font_Editor.ghx (Grasshopper 1.0.7)

pt = Point()
panel = Panel("ABCDEFG HIJKLMN")
panel_2 = Panel("OPQRSTU VWXYZ")
panel_3 = Panel("Hello World")
panel_4 = Panel("A-123")
panel_5 = Panel("Numbering")

# ---- group: text
python = GhPythonScript(TEXT="0123456789 ()*-_")  # -> out, TEXT_CURVE
# ---------- python: Python ----------
import rhinoscriptsyntax as rs


matrix_ = [
    ["A", [[0,0],[2,4],[4,0],[3,2],[1,2]]],
    ["B", [[0,0],[0,4],[3,4],[4,3],[3,2],[0,2],[3,2],[4,1],[3,0],[0,0]]],
    ["C", [[4,3],[3,4],[1,4],[0,3],[0,1],[1,0],[3,0],[4,1]]],
    ["D", [[0,4],[0,0],[2,0],[4,1],[4,3],[2,4],[0,4]]],
    ["E", [[4,4],[0,4],[0,2],[3,2],[0,2],[0,0],[4,0]]],
    ["F", [[4,4],[0,4],[0,2],[3,2],[0,2],[0,0]]],
    ["G", [[4,3],[3,4],[1,4],[0,3],[0,1],[1,0],[3,0],[4,1],[4,2],[2,2]]],
    ["H", [[0,4],[0,0],[0,2],[4,2],[4,4],[4,0]]],
    ["I", [[1,4],[3,4],[2,4],[2,0],[1,0],[3,0]]],
    ["J", [[0,4],[4,4],[4,1],[3,0],[1,0],[0,1]]],
    ["K", [[0,4],[0,0],[0,2],[4,4],[0,2],[4,0]]],
    ["L", [[0,4],[0,0],[4,0]]],
    ["M", [[0,0],[0,4],[2,0],[4,4],[4,0]]],
    ["N", [[0,0],[0,4],[4,0],[4,4]]],
    ["O", [[1,4],[3,4],[4,3],[4,1],[3,0],[1,0],[0,1],[0,3],[1,4]]],
    ["P", [[0,0],[0,4],[3,4],[4,3],[3,2],[0,2]]],
    ["Q", [[4,2],[4,3],[3,4],[1,4],[0,3],[0,1],[1,0],[3,0],[4,1],[4,2],[2,2],[4,0]]],
    ["R", [[0,0],[0,4],[3,4],[4,3],[3,2],[0,2],[3,2],[4,0]]],
    ["S", [[4,3],[3,4],[1,4],[0,3],[1,2],[3,2],[4,1],[3,0],[1,0],[0,1]]],
    ["T", [[0,4],[4,4],[2,4],[2,0]]],
    ["U", [[0,4],[0,1],[1,0],[3,0],[4,1],[4,4]]],
    ["V", [[0,4],[2,0],[4,4]]],
    ["W", [[0,4],[1,0],[2,4],[3,0],[4,4]]],
    ["X", [[0,4],[4,0],[2,2],[0,0],[4,4]]],
    ["Y", [[0,4],[2,2],[2,0],[2,2],[4,4]]],
    ["Z", [[0,4],[4,4],[0,0],[4,0],[0,0],[2,2],[1,3],[3,1]]],
    ["0", [[0,1],[4,3],[3,4],[1,4],[0,3],[0,1],[1,0],[3,0],[4,1],[4,3]]],
    ["1", [[1,3],[2,4],[2,0]]],
    ["2", [[0,3],[2,4],[4,3],[0,0],[4,0]]],
    ["3", [[0,3],[1,4],[3,4],[4,3],[3,2],[1,2],[3,2],[4,1],[3,0],[1,0],[0,1]]],
    ["4", [[4,2],[0,2],[3,4],[3,0]]],
    ["5", [[4,4],[0,4],[0,2],[3,2],[4,1],[3,0],[0,0]]],
    ["6", [[4,4],[0,4],[0,0],[4,0],[4,2],[0,2]]],
    ["7", [[0,3],[0,4],[4,4],[2,0]]],
    ["8", [[4,2],[0,2],[0,4],[4,4],[4,0],[0,0],[0,2]]],
    ["9", [[4,2],[0,2],[0,4],[4,4],[4,0],[0,0]]],
    ["*", [[1,3],[3,1],[2,2],[1,1],[3,3],[2,2],[2,4],[2,0]]],
    ["(", [[3,4],[1,3],[1,1],[3,0]]],
    [")", [[1,4],[3,3],[3,1],[1,0]]],
    ["-", [[0,2],[4,2]]],
    ["_", [[0,0],[4,0]]]
]



### Charactor
def construct_character(in_char):
    
    pts = []
    search = str(in_char).upper()
    
    
    for i in xrange(len(matrix_)):
        char, mat = matrix_[i]
        
        if search == char:
            
            ### polyline
            for j in xrange(len(mat)):
                m = mat[j]
                pts.append(rs.AddPoint(m[0] * 0.5, m[1], 0.0))
    
    return rs.AddPolyline(pts)



### String >> Charactor
def construct_text(text):
    
    out = []
    length_ = len(text)
    
    for i in xrange(length_):
        
        ### charactor
        t = text[i]
        pl = construct_character(str(t))
        pl_cp = rs.CopyObject(pl)
        
        ### Move
        pl_out = rs.MoveObject(pl_cp, (i*2.5, 0, 0))
        
        out.append(pl_out)
        
    
    return out, length_




TEXT_CURVE, length_ = construct_text(str(TEXT))

print(length_)
# ---------- end python ----------

# ---- group: csv formatter
inport = GhPythonScript(RECOMPUTE=Button())  # -> FORMAT
# ---------- inport: Python ----------
import csv


if RECOMPUTE:
    pass



with open('C:/Users/yoshioca/Documents/Matrix_Font/Matrix_Font.csv') as f:
    
    reader = csv.reader(f)
    l = [row for row in reader]



panel = []

for i in xrange(len(l)):
    
    ### reverse list
    # i = len(l) - (i+1)
    
    if i%2 == 0:
        
        # print(l[i])
        # print(l[i+1])
        
        
        ### formatter
        char = l[i]
        char = char[0]
        
        mat = str(l[i+1])
        mat = mat[1 : -1]
        mat = mat.replace("'", "")
        mat = mat.replace(" ", "")
        
        
        ### Set Dictionary
        out = "[\"{}\", {}],".format(char, mat)
        
        ### Debug, Number Slider
        # out = "[\"{}\", {}],".format(int(i/2), mat)
        
        
        print(out)
        
        panel.append(out)



FORMAT = panel
# ---------- end inport ----------

# ---- group: editor, calc
python_2 = GhPythonScript(BASE=pt)  # -> MATRIX; inputs BASE: list
# ---------- python_2: Python ----------
import rhinoscriptsyntax as rs

def export_matrix(points):
    
    matrix = []
    
    for i in xrange(len(points)):
        
        mat = []
        pt = rs.coerce3dpoint(points[i])
        
        mat.append(int(pt.X))
        mat.append(int(pt.Y))
        
        matrix.append(mat)
    
    return matrix



mat = export_matrix(BASE)
MATRIX = str(mat)
# ---------- end python_2 ----------

# ---- group: debuger / constructor
python_3 = GhPythonScript(NUM=Slider(14, range=0..40))  # -> out, a
# ---------- python_3: Python ----------
import rhinoscriptsyntax as rs




matrix_ = [
    ["0", [[0,0],[2,4],[4,0],[3,2],[1,2]]],
    ["1", [[0,0],[0,4],[3,4],[4,3],[3,2],[0,2],[3,2],[4,1],[3,0],[0,0]]],
    ["2", [[4,3],[3,4],[1,4],[0,3],[0,1],[1,0],[3,0],[4,1]]],
    ["3", [[0,4],[0,0],[2,0],[4,1],[4,3],[2,4],[0,4]]],
    ["4", [[4,4],[0,4],[0,2],[3,2],[0,2],[0,0],[4,0]]],
    ["5", [[4,4],[0,4],[0,2],[3,2],[0,2],[0,0]]],
    ["6", [[4,3],[3,4],[1,4],[0,3],[0,1],[1,0],[3,0],[4,1],[4,2],[2,2]]],
    ["7", [[0,4],[0,0],[0,2],[4,2],[4,4],[4,0]]],
    ["8", [[1,4],[3,4],[2,4],[2,0],[1,0],[3,0]]],
    ["9", [[0,4],[4,4],[4,1],[3,0],[1,0],[0,1]]],
    ["10", [[0,4],[0,0],[0,2],[4,4],[0,2],[4,0]]],
    ["11", [[0,4],[0,0],[4,0]]],
    ["12", [[0,0],[0,4],[2,0],[4,4],[4,0]]],
    ["13", [[0,0],[0,4],[4,0],[4,4]]],
    ["14", [[1,4],[3,4],[4,3],[4,1],[3,0],[1,0],[0,1],[0,3],[1,4]]],
    ["15", [[0,0],[0,4],[3,4],[4,3],[3,2],[0,2]]],
    ["16", [[4,2],[4,3],[3,4],[1,4],[0,3],[0,1],[1,0],[3,0],[4,1],[4,2],[2,2],[4,0]]],
    ["17", [[0,0],[0,4],[3,4],[4,3],[3,2],[0,2],[3,2],[4,0]]],
    ["18", [[4,3],[3,4],[1,4],[0,3],[1,2],[3,2],[4,1],[3,0],[1,0],[0,1]]],
    ["19", [[0,4],[4,4],[2,4],[2,0]]],
    ["20", [[0,4],[0,1],[1,0],[3,0],[4,1],[4,4]]],
    ["21", [[0,4],[2,0],[4,4]]],
    ["22", [[0,4],[1,0],[2,4],[3,0],[4,4]]],
    ["23", [[0,4],[4,0],[2,2],[0,0],[4,4]]],
    ["24", [[0,4],[2,2],[2,0],[2,2],[4,4]]],
    ["25", [[0,4],[4,4],[0,0],[4,0],[0,0],[2,2],[1,3],[3,1]]],
    ["26", [[0,1],[4,3],[3,4],[1,4],[0,3],[0,1],[1,0],[3,0],[4,1],[4,3]]],
    ["27", [[1,3],[2,4],[2,0]]],
    ["28", [[0,3],[2,4],[4,3],[0,0],[4,0]]],
    ["29", [[0,3],[1,4],[3,4],[4,3],[3,2],[1,2],[3,2],[4,1],[3,0],[1,0],[0,1]]],
    ["30", [[4,2],[0,2],[3,4],[3,0]]],
    ["31", [[4,4],[0,4],[0,2],[3,2],[4,1],[3,0],[0,0]]],
    ["32", [[4,4],[0,4],[0,0],[4,0],[4,2],[0,2]]],
    ["33", [[0,3],[0,4],[4,4],[2,0]]],
    ["34", [[4,2],[0,2],[0,4],[4,4],[4,0],[0,0],[0,2]]],
    ["35", [[4,2],[0,2],[0,4],[4,4],[4,0],[0,0]]],
    ["36", [[1,3],[3,1],[2,2],[1,1],[3,3],[2,2],[2,4],[2,0]]],
    ["37", [[3,4],[1,3],[1,1],[3,0]]],
    ["38", [[1,4],[3,3],[3,1],[1,0]]],
    ["39", [[0,2],[4,2]]],
    ["40", [[0,0],[4,0]]]
]


def construct_character(in_char):
    
    pts = []
    search = str(in_char).upper()
    
    
    for i in xrange(len(matrix_)):
        char, mat = matrix_[i]
#        print("{}, {}".format(char, mat))
        
        if search == char:
            
            ### polyline
            for j in xrange(len(mat)):
                m = mat[j]
                pts.append(rs.AddPoint(m[0] * 0.5, m[1], 0.0))
    
    return rs.AddPolyline(pts)



#a = construct_character("g")
a = construct_character(str(int(NUM)))
# ---------- end python_3 ----------

# ----
preview = CustomPreview(
    Geometry=python_3.a,
    Material={diffuse=RGB(221, 160, 221), emission=RGB(66, 48, 66), shine=0.5, specular=RGB(255, 255, 255), transparency=0})
panel_6 = Panel(inport)
panel_7 = Panel(python_2)
crv = Curve(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)

# ---- group: frame
python_4 = GhPythonScript(COUNT=python.out, FRAME=crv)  # -> out, a
# ---------- python_4: Python ----------
import rhinoscriptsyntax as rs

crv = []
frame = FRAME

for i in xrange(int(COUNT)):
    ### Frame
    cp = rs.CopyObject(frame)
    # print(i)
    tmp = rs.MoveObject(cp,  (i*2.5, 0, -1))
    crv.append(tmp)


a = crv
# ---------- end python_4 ----------

# ----
srf = Surface(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)
preview_2 = CustomPreview(Geometry=python.TEXT_CURVE, Material=ColourSwatch(SwatchColor=RGB(0, 0, 255)))
preview_3 = CustomPreview(Geometry=python_4.a, Material=ColourSwatch(SwatchColor=RGBA(118, 121, 126, 36)))
preview_4 = CustomPreview(Geometry=srf, Material=ColourSwatch(SwatchColor=RGB(220, 220, 220)))
